# Grasshopper definition Final Design.gh (Grasshopper 1.0.7)

number_slider = Slider(0, range=0..100)
vector_xyz = VectorXYZ(XComponent=number_slider, YComponent=number_slider, ZComponent=number_slider)  # -> Vector, Length
number_slider_2 = Slider(95, range=1..100)
point = Point(vector_xyz.Vector)
rectangle = Rectangle(Plane=point, XSize=number_slider_2, YSize=number_slider_2, Radius=0)  # -> Rectangle, Length
number_slider_3 = Slider(-48, range=-100..1)
unit_z = UnitZ(Factor=Slider(3.5, range=1..20))
solid_union = SolidUnion(Breps=rectangle.Rectangle)
extrude = Extrude(Base=solid_union, Direction=unit_z)
vector_xyz_2 = VectorXYZ(XComponent=number_slider_3, YComponent=number_slider_3, ZComponent=Slider(-3.12, range=-30..5))  # -> Vector, Length
move = Move(Geometry=extrude, Motion=vector_xyz_2.Vector)  # -> Geometry, Transform
custom_preview = CustomPreview(Geometry=move.Geometry, Material=ColourSwatch(SwatchColor=RGB(173, 198, 199)))

# ---- group: 2 Parameters
number_slider_4 = Slider(3, range=0.1..3)
number_slider_5 = Slider(30, range=1..30)

# ----
series = Series(Start=0, Step=Slider(0.4, range=0.1..1), Count=Slider(9, range=1..20))
series_2 = Series(Start=0, Step=1, Count=number_slider_5)
fibonacci = Fibonacci(SeedA=0, SeedB=1, Number=series)
series_3 = Series(Start=number_slider_4, Step=Slider(0.1, range=0..1), Count=Slider(30, range=0..100))
vector_xyz_3 = VectorXYZ(XComponent=series_2, YComponent=series_2, ZComponent=0)  # -> Vector, Length
rectangle_2 = Rectangle(Plane=PlaneXY(0, 0, 0), XSize=fibonacci, YSize=fibonacci, Radius=0)  # -> Rectangle, Length
sine = Sine(Value=series_3)
addition = Addition(A=number_slider_5, B=Slider(1, range=0..1))
move_2 = Move(Geometry=rectangle_2.Rectangle, Motion=vector_xyz_3.Vector)  # -> Geometry, Transform
multiplication = Multiplication(A=sine, B=Slider(18, range=0..100))
series_4 = Series(Start=Slider(0.01, range=0..0.01), Step=addition, Count=Slider(30, range=1..360))
absolute = Absolute(Value=multiplication)
rotate_3d = Rotate3D(Geometry=move_2.Geometry, Angle=degrees(series_4), Center=Point(0, 0, 0), Axis=Vector(0, 0, 1))  # -> Geometry, Transform
unit_z_2 = UnitZ(Factor=absolute)
rotate_3d_2 = Rotate3D(
    geometry_2=rotate_3d.Geometry,
    angle_2=Slider(270, range=0..1000),
    geometry=rotate_3d.Geometry,
    angle=Slider(180, range=0..1000),
    geometry_3=rotate_3d.Geometry,
    angle_3=Slider(90, range=0..100))  # -> geometry_5, geometry_4, geometry_6
extrude_2 = Extrude(
    base=rotate_3d_2.geometry_5,
    direction=unit_z_2,
    base_2=rotate_3d_2.geometry_4,
    direction_2=unit_z_2,
    base_4=rotate_3d_2.geometry_6,
    direction_4=unit_z_2,
    base_3=rotate_3d.Geometry,
    direction_3=unit_z_2)  # -> extrusion, extrusion_2, extrusion_4, extrusion_3
colour_swatch = ColourSwatch(SwatchColor=RGB(0, 0, 0))
colour_swatch_2 = ColourSwatch(SwatchColor=RGB(255, 255, 255))
custom_preview_2 = CustomPreview(
    geometry=extrude_2.extrusion,
    material=colour_swatch,
    geometry_2=extrude_2.extrusion_2,
    material_2=colour_swatch_2,
    geometry_4=extrude_2.extrusion_4,
    material_4=colour_swatch,
    geometry_3=extrude_2.extrusion_3,
    material_3=colour_swatch_2)

# ==== cluster Extrude
base = ClusterInput()
direction = ClusterInput()
base_2 = ClusterInput()
direction_2 = ClusterInput()
base_3 = ClusterInput()
direction_3 = ClusterInput()
base_4 = ClusterInput()
direction_4 = ClusterInput()
extrude = Extrude(Base=base, Direction=direction)
extrude_2 = Extrude(Base=base_2, Direction=direction_2)
extrude_3 = Extrude(Base=base_3, Direction=direction_3)
extrude_4 = Extrude(Base=base_4, Direction=direction_4)
extrusion = ClusterOutput(extrude)
extrusion_2 = ClusterOutput(extrude_2)
extrusion_3 = ClusterOutput(extrude_3)
extrusion_4 = ClusterOutput(extrude_4)

# ==== cluster Rotate3D
geometry = ClusterInput()
angle = ClusterInput()
geometry_2 = ClusterInput()
angle_2 = ClusterInput()
geometry_3 = ClusterInput()
angle_3 = ClusterInput()
rotate_3d = Rotate3D(Geometry=geometry, Angle=degrees(angle), Center=Point(0, 0, 0), Axis=Vector(0, 0, 1))  # -> Geometry, Transform
rotate_3d_2 = Rotate3D(Geometry=geometry_2, Angle=degrees(angle_2), Center=Point(0, 0, 0), Axis=Vector(0, 0, 1))  # -> Geometry, Transform
rotate_3d_3 = Rotate3D(Geometry=geometry_3, Angle=degrees(angle_3), Center=Point(0, 0, 0), Axis=Vector(0, 0, 1))  # -> Geometry, Transform
geometry_4 = ClusterOutput(rotate_3d.Geometry)
geometry_5 = ClusterOutput(rotate_3d_2.Geometry)
geometry_6 = ClusterOutput(rotate_3d_3.Geometry)

# ==== cluster CustomPreview
geometry = ClusterInput()
material = ClusterInput()
geometry_2 = ClusterInput()
material_2 = ClusterInput()
geometry_3 = ClusterInput()
material_3 = ClusterInput()
geometry_4 = ClusterInput()
material_4 = ClusterInput()
custom_preview = CustomPreview(Geometry=geometry, Material=material)
custom_preview_2 = CustomPreview(Geometry=geometry_2, Material=material_2)
custom_preview_3 = CustomPreview(Geometry=geometry_3, Material=material_3)
custom_preview_4 = CustomPreview(Geometry=geometry_4, Material=material_4)
