# Grasshopper definition Initial design and idea.gh (Grasshopper 1.0.7)

number_slider = Slider(3, range=1..20)
series = Series(Start=0, Step=1, Count=number_slider)
series_2 = Series(Start=0, Step=1, Count=Slider(7, range=1..20))
series_3 = Series(Start=0, Step=Slider(1.846, range=0..5), Count=Slider(20, range=1..20))
series_4 = Series(Start=0, Step=1, Count=Slider(20, range=1..50))
rectangle = Rectangle(Plane=PlaneXY(0, 0, 0), XSize=Slider(31, range=1..40), YSize=Slider(15, range=1..30), Radius=0)  # -> Rectangle, Length
expression = Expression(x=series_2, Expression="6*(sin(x-1.5))+6")
expression_2 = Expression(x=series_3, Expression="6*(sin(x))")
construct_point = ConstructPoint(XCoordinate=series_4, YCoordinate=graft(series), ZCoordinate=0)
unit_z = UnitZ(Factor=Slider(3.5, range=1..20))
series_5 = Series(Start=0, Step=Slider(2, range=1..10), Count=Slider(7, range=1..20))
solid_union = SolidUnion(Breps=rectangle.Rectangle)
deconstruct = Deconstruct(Point=construct_point)  # -> XComponent, YComponent, ZComponent
construct_point_2 = ConstructPoint(XCoordinate=deconstruct.XComponent, YCoordinate=deconstruct.YComponent, ZCoordinate=expression_2)
vector_xyz = VectorXYZ(XComponent=expression, YComponent=series_5, ZComponent=0)  # -> Vector, Length
extrude = Extrude(Base=solid_union, Direction=unit_z)
vector_xyz_2 = VectorXYZ(XComponent=0, YComponent=Slider(-0.456, range=-1..1), ZComponent=Slider(-3.654, range=-4..5))  # -> Vector, Length
surface_from_points = SurfaceFromPoints(Points=flatten(construct_point_2), UCount=number_slider, Interpolate=False)
move = Move(Geometry=surface_from_points, Motion=vector_xyz.Vector)  # -> Geometry, Transform
move_2 = Move(Geometry=extrude, Motion=vector_xyz_2.Vector)  # -> Geometry, Transform
colour_swatch = ColourSwatch(SwatchColor=RGB(24, 216, 237))
custom_preview = CustomPreview(Geometry=move_2.Geometry, Material=colour_swatch)
custom_preview_2 = CustomPreview(Geometry=move.Geometry, Material=colour_swatch)
