# Grasshopper definition para try.gh (Grasshopper 1.0.7)

series = Series(Start=0, Step=Slider(1, range=1..20), Count=Slider(5, range=1..20))  # -> graft(Series)
series_2 = Series(Start=Slider(1, range=0..1), Step=Slider(1, range=1..20), Count=Slider(9, range=1..20))  # -> graft(Series)
unit_z = UnitZ(Factor=series)
series_3 = Series(Start=0, Step=Slider(12, range=1..20), Count=Slider(11, range=0..360))
polygon = Polygon(Plane=PlaneXY(0, 0, 0), Radius=series_2, Segments=6, FilletRadius=0)  # -> Polygon, Length
extrude = Extrude(Base=polygon.Polygon, Direction=unit_z)
rotate_3d = Rotate3D(Geometry=extrude, Angle=degrees(series_3), Center=Point(0, 0, 0), Axis=Vector(0, 0, 1))  # -> Geometry, Transform
custom_preview = CustomPreview(
    Geometry=rotate_3d.Geometry,
    Material={diffuse=RGB(228, 178, 227), emission=RGB(68, 53, 68), shine=0.5, specular=RGB(255, 254, 254), transparency=0})
